% Simulink data dictionary ModelDD.sldd

ADPTV = struct(
  delta=single(1.3912),
  eta=single(2.6286),
  k=single(3.3772),
  psi0=single([901.847412 1222.95764; -1260.73474 833.598938]),
  mio_0=single(18.3132),
  mio_inf=single(18.3132),
  a=single(44.0085),
  ro=single(0.6135),
  wo=single(0.1967),
  Lamda0=single(88.4281),
  LamdaInf=single(88.4281),
  b0=single(0.001),
  h=single(1.0e-6),
  b_D_ui=single(0.2547))

Ctrl = struct(
  ModReq=false,
  FrcPwr=false,
  EnableMonitors=true,
  PorISel=true,
  Test=false,
  EnPll=true,
  IdSp=single(0),
  IqSp=single(0),
  PSp=single(0),
  QSp=single(0),
  SogiK=single(0.707106769),
  PllKp=single(44.4288),
  PllKi=single(1395.8),
  CurCont_Kp=single(1.39315009),
  CurCont_Ki=single(348.287506),
  Pwr_Kp=single(0.000452532899),
  Pwr_Ki=single(0.415730953))

EnableMonitors = false
FrcPwr = true

Hil = struct(
  MeasLogTime=100,
  MeasFastSmplTime=2e-05,
  MeasSlowSmplTime=2e-05,
  MeasFastLogLim=5000000,
  MeasSlowLogLim=5000000,
  HVDC_V=650,
  HVDC_Vesr=0.01,
  HVDC_Vesl=1.0e-6,
  HVDC_C=0.00026,
  HVDC_Cesr=0.05,
  HVDC_Cesl=1.0e-8,
  HVDC_Rpasiv=385000,
  Grid_VphRms=220,
  Grid_Frq=50,
  Harm_Freq=[3 5 7],
  Harm_Amp=[0 0.05 0.025],
  Inductor_L=0.002,
  Inductor_R=0.001,
  Transformer_N=4,
  Transformer_R1=0.0992,
  Transformer_R2=0.3,
  Transformer_L1=0.0006613,
  Transformer_L2=0.002,
  Transformer_Rc=1000,
  Transformer_Lm=0.4959,
  PWM_Freq=10000,
  PWM_Deadtime=0,
  Sic_Ron=0.047,
  Sic_Vdiode=1.7,
  Sic_Rdiode=0.055,
  ADC_CH0_PHY_Gain=666.6667,
  ADC_CH1_PHY_Gain=666.6667,
  ADC_CH2_PHY_Gain=66.66667,
  ADC_CH3_PHY_Gain=66.66667,
  ADC_CH4_PHY_Gain=66.66667,
  ADC_CH5_PHY_Gain=666.6667,
  ADC_CH0_PHY_OFFSET=1.5075,
  ADC_CH1_PHY_OFFSET=1.5,
  ADC_CH2_PHY_OFFSET=1.5,
  ADC_CH3_PHY_OFFSET=1.5,
  ADC_CH4_PHY_OFFSET=1.5,
  ADC_CH5_PHY_OFFSET=1.5,
  ADC_VgnoiseStd=[1.8625 1.8326 2.0763],
  ADC_InoiseStd=[0.1803 0.2147 0.3315],
  ADC_VdcnoiseStd=1.4157)

IdSp = single(0)
IqSp = single(0)
ModReq = true
PSp = single(0)
PorISel = false
QSp = single(0)

Sim = struct(
  SimOrHw="Sim",
  PlantOrMeas="HIL",
  ExternalOrComm="External",
  FltInj="Two Phase Flt",
  SOGISel="3P SOGI Disc",
  CC_Enable=3,
  Modulation="SPWM",
  FiltDcOff="LPF",
  ADC_UabcSensor="Three Currents",
  ADC_SE_or_Diff=0,
  RunTime=1,
  ContSampleTime=2e-05,
  MeasLogTime=100,
  MeasFastSmplTime=0.0005,
  MeasSlowSmplTime=0.001,
  HilModel="TarazAvg",
  PwmModel="Average")

Test = false

Var = struct(
  HVDC_V=single(650),
  HVDC_C=single(0.00026),
  HVDC_Cesr=single(0.0001),
  HVDC_L=single(1.0e-8),
  HVDC_Lesr=single(1.0e-5),
  Grid_Frq=single(50),
  Inductor_L=single(0.002),
  Inductor_R=single(0.001),
  Transformer_N=single(4),
  Transformer_R1=single(0.0992),
  Transformer_R2=single(0.3),
  Transformer_L1=single(0.0006613),
  Transformer_L2=single(0.002),
  PWM_Freq=single(10000),
  PWM_Deadtime=single(1.0e-6),
  ADC_Res=single(4096),
  Pll_MaxDeltaFreq=single(10000),
  CurCont_MaxVdVq=single(400),
  States_HvdcUActMin=single(60),
  States_HvacUActMin=single(20),
  States_StdbyToPwrTime=single(0),
  Diag_IrmsOc=single(40),
  Diag_tIrmsDtc=single(0.001),
  Diag_HvdcUOv=single(800),
  Diag_tHvdcUOvDtc=single(0.001),
  Diag_AdcOorHLim=single(4046),
  Diag_AdcOorLLim=single(50),
  Diag_tOorHDtc=single(1.0e-6),
  Diag_tOorLDtc=single(1.0e-6),
  ADC_CH0_Gain=single(0.000732600747),
  ADC_CH1_Gain=single(0.000732600747),
  ADC_CH2_Gain=single(0.000732600747),
  ADC_CH3_Gain=single(0.000732600747),
  ADC_CH4_Gain=single(0.000732600747),
  ADC_CH5_Gain=single(0.000732600747),
  ADC_CH0_OFFSET=single(0),
  ADC_CH1_OFFSET=single(0),
  ADC_CH2_OFFSET=single(0),
  ADC_CH3_OFFSET=single(0),
  ADC_CH4_OFFSET=single(0),
  ADC_CH5_OFFSET=single(0),
  ADC_CH0_PHY_Gain=single(666.666687),
  ADC_CH1_PHY_Gain=single(666.666687),
  ADC_CH2_PHY_Gain=single(66.6666641),
  ADC_CH3_PHY_Gain=single(66.6666641),
  ADC_CH4_PHY_Gain=single(66.6666641),
  ADC_CH5_PHY_Gain=single(666.666687),
  ADC_CH0_PHY_OFFSET=single(1.5),
  ADC_CH1_PHY_OFFSET=single(1.5),
  ADC_CH2_PHY_OFFSET=single(1.5),
  ADC_CH3_PHY_OFFSET=single(1.5),
  ADC_CH4_PHY_OFFSET=single(1.5),
  ADC_CH5_PHY_OFFSET=single(1.48498166))